# Grasshopper definition absolute.ghx (Grasshopper 1.0.8)
# plug-ins: Bifocals

panel = Panel("""2
2.7
-3.666
22222222222222222""")

panel_2 = Panel("DEF")
vec = VectorXYZ(XComponent="1", YComponent="-30", ZComponent="30")  # -> Vector, Length

path = FilePath("D:\Keon Chae\Workshop\HakLeeGHStudy\week_1\absolute.py")
py3 = Python3Script(script=path, x=panel)  # -> out, a; unedited script template
abs = Absolute(Value=panel)
python = GhPythonScript(x=panel)  # -> out, a; unedited script template
panel_3 = Panel(abs)
panel_4 = Panel(python.a)
panel_5 = Panel(py3.a)
equals = Equality(FirstNumber=abs, SecondNumber=python.a)  # -> Equality, Inequality
panel_6 = Panel(equals.Equality)
