# Grasshopper definition addition.ghx (Grasshopper 1.0.8)

panel = Panel("""ABC
123456789123456789""")
panel_2 = Panel("""DEF
-123456789123456788""")

panel_3 = Panel("""1
1.3
1.333
111111111111111""")
panel_4 = Panel("""2
2.7
-3.666
22222222222222222""")
panel_5 = Panel("""2
2.7
-3.666
22222222222222222""")
panel_6 = Panel("""1
1.3
1.333
111111111111111""")
path = FilePath("D:\Keon Chae\Workshop\HakLeeGHStudy\week_1\addtion.py")
py3 = Python3Script(script=path, x=panel_3, y=panel_4)  # -> out, a; unedited script template
addition = Addition(A=panel_6, B=panel_5)
python = GhPythonScript(x=panel_6, y=panel_5)  # -> out, a; unedited script template
py3_2 = Python3Script(x=panel, y=panel_2)  # -> out, a
# ---------- py3_2: Python ----------
import rhinoscriptsyntax as rs

a = x + y
print(a)
# ---------- end py3_2 ----------
addition_2 = Addition(A=panel, B=panel_2)
py3_3 = Python3Script(x=panel_3, y=panel_4)  # -> out, a
# ---------- py3_3: Python ----------
import rhinoscriptsyntax as rs

x = float(x)
y = float(y)
a = x + y
print(a)
# ---------- end py3_3 ----------
py3_4 = Python3Script(x=panel_3, y=panel_4)  # -> out, a
# ---------- py3_4: Python ----------
# ! python3
# venv: HakLeeGHStudy

import rhinoscriptsyntax as rs

x = float(x)
y = float(y)
a = x + y
print(a)
# ---------- end py3_4 ----------
addition_3 = Addition(A=panel_3, B=panel_4)
panel_7 = Panel(addition)
panel_8 = Panel(python.a)
equals = Equality(FirstNumber=addition, SecondNumber=python.a)  # -> Equality, Inequality
equals_2 = Equality(FirstNumber=addition_3, SecondNumber=py3_4.a)  # -> Equality, Inequality
panel_9 = Panel(py3.a)
equals_3 = Equality(FirstNumber=addition_2, SecondNumber=py3_2.a)  # -> Equality, Inequality
panel_10 = Panel(equals.Equality)
