# Grasshopper definition bounds.ghx (Grasshopper 1.0.8)

panel = Panel("""1
2
3
4
5""")
path = FilePath("D:\Keon Chae\Workshop\HakLeeGHStudy\week_1\bounds.py")
py3 = Python3Script(script=path, N=panel)  # -> out, domain; inputs N: list; unedited script template
python = GhPythonScript(X=panel)  # -> Out, A
bnd = Bounds(Numbers=panel)
py3_2 = Python3Script()  # -> out, a; unedited script template
panel_2 = Panel(bnd)
panel_3 = Panel(py3.domain)
equals = Equality(FirstNumber=bnd, SecondNumber=panel_2)  # -> Equality, Inequality
