# Grasshopper definition larger-than.ghx (Grasshopper 1.0.8)

panel = Panel("""ABC
123456789123456789""")
panel_2 = Panel("""DEF
-123456789123456788""")

panel_3 = Panel("""2
2.7
-3.666
22222222222222222""")
panel_4 = Panel("""1
1.3
1.333
111111111111111""")
path = FilePath("D:\Keon Chae\Workshop\HakLeeGHStudy\week_1\larger-than.py")
larger = LargerThan(FirstNumber=panel_4, SecondNumber=panel_3)  # -> LargerThan, OrEqualTo
python = GhPythonScript(x=panel_4, y=panel_3)  # -> out, a, b; unedited script template
py3 = Python3Script(script=path, x=panel_4, y=panel_3)  # -> out, larger_than, larger_or_equal; unedited script template
panel_5 = Panel(larger.LargerThan)
panel_6 = Panel(python.a)
panel_7 = Panel(python.b)
panel_8 = Panel(larger.OrEqualTo)
panel_9 = Panel(py3.larger_than)
panel_10 = Panel(py3.larger_or_equal)
equals = Equality(FirstNumber=larger.OrEqualTo, SecondNumber=python.b)  # -> Equality, Inequality
equals_2 = Equality(FirstNumber=larger.LargerThan, SecondNumber=python.a)  # -> Equality, Inequality
panel_11 = Panel(equals.Equality)
panel_12 = Panel(equals_2.Equality)
