# Grasshopper definition mass-multiplication.ghx (Grasshopper 1.0.8)
# plug-ins: Bifocals

panel = Panel("""2
2.7
-3.666""")
path = FilePath("D:\Keon Chae\Workshop\HakLeeGHStudy\week_1\mass-multiplication.py")
py3 = Python3Script(script=path, l=panel)  # -> out, R, Pr; inputs l: list; unedited script template
python = GhPythonScript(x=panel)  # -> out, a, b; unedited script template
mm = MassMultiplication(Input=panel)  # -> Result, PartialResults
panel_2 = Panel(mm.PartialResults)
panel_3 = Panel(mm.Result)
panel_4 = Panel(python.a)
panel_5 = Panel(python.b)
panel_6 = Panel(py3.R)
panel_7 = Panel(py3.Pr)
equals = Equality(FirstNumber=mm.PartialResults, SecondNumber=python.b)  # -> Equality, Inequality
equals_2 = Equality(FirstNumber=mm.Result, SecondNumber=python.a)  # -> Equality, Inequality
panel_8 = Panel(equals.Equality)
panel_9 = Panel(equals_2.Equality)
